# Grasshopper definition 211205.gh (Grasshopper 1.0.7)

# ----
# Create PH_Lighting
# Dev Note: Compos updated to reload()
panel = Panel("12")
constantschedule = HBConstantSchedule(values="1")  # -> report, schedule, idf_text; plug-in component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
ph_lighting = GhPythonScript(name="MyTest", watts_per_area=panel, schedule=constantschedule.schedule)  # -> out, ph_lighting, dup_ph_lighting
# ---------- ph_lighting: Python ----------
import honeybee_energy.load.lighting
reload(honeybee_energy.load.lighting)

try:  # import the core honeybee dependencies
    from honeybee.typing import clean_and_id_ep_string, clean_ep_string
except ImportError as e:
    raise ImportError('\nFailed to import honeybee:\n\t{}'.format(e))
    
# Subclass HB Energy Lighting
class PH_Lighting(honeybee_energy.load.lighting.Lighting):
    __slots__ = ('_test_attr')
    
    def __init__(self, *args, **kwargs):
        super(PH_Lighting, self).__init__(*args, **kwargs)
        self._test_attr = 'this is a test'
    
    @classmethod
    def from_hb_lighting(cls, _hb_lighting):
        new_ph_obj = cls(
            identifier=_hb_lighting.identifier,
            watts_per_area=_hb_lighting.watts_per_area,
            schedule=_hb_lighting.schedule,
            return_air_fraction=_hb_lighting.return_air_fraction,
            radiant_fraction=_hb_lighting.radiant_fraction,
            visible_fraction=_hb_lighting.visible_fraction,)
        
        return new_ph_obj
    
    def ToString(self):
        return 'My New PH_Lighting Object'
    
    def __copy__(self):
        new_hb_obj = super(PH_Lighting, self).__copy__()
        new_ph_obj = PH_Lighting.from_hb_lighting(new_hb_obj)
        new_ph_obj._test_attr = self._test_attr
        return new_ph_obj
        
# Create a new PH Lighting Obj
name = clean_ep_string(_name)
ph_lighting_ = PH_Lighting(name, _watts_per_area, _schedule)
print ph_lighting_._test_attr

dup_ph_lighting_ = ph_lighting_.duplicate()
print dup_ph_lighting_
print dup_ph_lighting_._test_attr #- Works
# ---------- end ph_lighting ----------

searchprog = HBSearchPrograms()  # -> room_prog; plug-in component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
box = Box2Pt(PointA="10,0,0", PointB="20,10,3", Plane=PlaneXY(0, 0, 0))
box_2 = Box2Pt(PointA="0,0,0", PointB="10,10,6", Plane=PlaneXY(0, 0, 0))
item = ListItem(List=searchprog, Index="0", Wrap=True)
roomsolid = HBRoomFromSolid(geo=flatten(box_2), name="First Room", conditioned=True)  # -> report, rooms; plug-in component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
roomsolid_2 = HBRoomFromSolid(geo=flatten(box), name="Room 2", conditioned=True)  # -> report, rooms; plug-in component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
programtype = HBProgramType(name="Test_Program", base_program=item, lighting=ph_lighting.dup_ph_lighting)  # -> program; plug-in component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
applyprogram = HBApplyProgramType(rooms=flatten(roomsolid.rooms), program=programtype)  # -> report, rooms; plug-in component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
python = GhPythonScript(room=roomsolid.rooms)  # -> out, a
# ---------- python: Python ----------
print _room
print _room.properties.energy.lighting
print _room.properties.energy.lighting.properties # Works!
# ---------- end python ----------
merge = Merge(Data1=roomsolid.rooms, Data2=roomsolid_2.rooms)  # -> flatten(Result)
applyloadvals = HBApplyLoadValues(room_or_program=flatten(applyprogram.rooms), lighting_per_floor="100")  # -> report, mod_obj; plug-in component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
solveadj = HBSolveAdjacency(rooms=flatten(merge), run=Toggle(True))  # -> report, adj_rooms; plug-in component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
python_2 = GhPythonScript()  # -> out, space_breps, HB_rooms; inputs HB_rooms: list
# ---------- python_2: Python ----------
HB_rooms_ = []
for _room in _HB_rooms:
    new_room = _room.duplicate()
    print new_room.properties.ph
    
    for face in new_room.faces:
        print face.properties.ph
# ---------- end python_2 ----------
aperturesbyratio = HBAperturesByRatio(hb_objs=flatten(solveadj.adj_rooms), ratio=".2")  # -> report, hb_objs; plug-in component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
objtostr = HBObjectToString(hb_obj=roomsolid.rooms)  # -> hb_str; plug-in component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
model = HBModel(rooms=flatten(aperturesbyratio.hb_objs))  # -> report, model; plug-in component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
panel_2 = Panel(model.model)
python_3 = GhPythonScript(x=objtostr)  # -> out, a
# ---------- python_3: Python ----------
import json

d = json.loads(x)

print d['properties'].keys()
print d['properties']['ph'].keys()
# ---------- end python_3 ----------
panel_3 = Panel("\\Mac\Dropbox\bldgtyp-00\00_PH_Tools\honeybee_PH\sample\hbjson\")
vizbytype = HBVisualizeByType()  # -> walls, interior_walls, roofs, ceilings, exterior_floors, interior_floors, air_walls, apertures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; plug-in component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
dumpobjects = HBDumpObjects(name="sample_input", folder=panel_3, indent="2", dump=Toggle(False))  # -> report, hb_file; plug-in component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
vizbybc = HBVizualizeByBC()  # -> outdoors, surface, ground, adiabatic, other, wire_frame; plug-in component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
