# Grasshopper definition hbph_test_models.gh (Grasshopper 1.0.7)

box = Box2Pt(PointA="0,0,0", PointB="5,4,3", Plane=PlaneXY(0, 0, 0))
box_2 = Box2Pt(PointA="0,0,0", PointB="5,4,3", Plane=PlaneXY(0, 0, 0))
box_3 = Box2Pt(PointA="0,0,0", PointB="5,4,3", Plane=PlaneXY(0, 0, 0))
box_4 = Box2Pt(PointA="5,0,0", PointB="12,4,3", Plane=PlaneXY(0, 0, 0))
box_5 = Box2Pt(PointA="0,0,0", PointB="5,4,3", Plane=PlaneXY(0, 0, 0))
box_6 = Box2Pt(PointA="0,0,0", PointB="5,4,3", Plane=PlaneXY(0, 0, 0))
box_7 = Box2Pt(PointA="5,0,0", PointB="12,4,3", Plane=PlaneXY(0, 0, 0))
box_8 = Box2Pt(PointA="0,0,0", PointB="5,4,3", Plane=PlaneXY(0, 0, 0))
roomsolid = HBRoomFromSolid(geo=flatten(box), conditioned=True)  # -> report, rooms; plug-in component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
roomsolid_2 = HBRoomFromSolid(geo=flatten(box_3), conditioned=True)  # -> report, rooms; plug-in component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
roomsolid_3 = HBRoomFromSolid(geo=flatten(box_6), conditioned=True)  # -> report, rooms; plug-in component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
roomsolid_4 = HBRoomFromSolid(geo=flatten([box_2, box_4]), conditioned=True)  # -> report, rooms; plug-in component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
roomsolid_5 = HBRoomFromSolid(geo=flatten(box_8), conditioned=True)  # -> report, rooms; plug-in component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
roomsolid_6 = HBRoomFromSolid(geo=flatten([box_5, box_7]), conditioned=True)  # -> report, rooms; plug-in component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
ln = Line(StartPoint="0,0,0", EndPoint="-20,20,0")
extr = Extrude(Base=ln, Direction="0,0,5")
model = HBModel(rooms=flatten(roomsolid_2.rooms))  # -> report, model; plug-in component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
solveadj = HBSolveAdjacency(rooms=flatten(roomsolid_4.rooms), run=Toggle(True))  # -> report, adj_rooms; plug-in component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
solveadj_2 = HBSolveAdjacency(rooms=flatten(roomsolid_6.rooms), run=Toggle(True))  # -> report, adj_rooms; plug-in component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
aperturesbyratio = HBAperturesByRatio(hb_objs=flatten(roomsolid.rooms), ratio="0.45", subdivide=Toggle(False))  # -> report, hb_objs; plug-in component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
shade = HBShade(geo=extr)  # -> report, shades; plug-in component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
model_2 = HBModel(rooms=flatten(aperturesbyratio.hb_objs))  # -> report, model; plug-in component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
model_3 = HBModel(rooms=flatten(roomsolid_5.rooms), shades=flatten(shade.shades))  # -> report, model; plug-in component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
aperturesbyratio_2 = HBAperturesByRatio(hb_objs=flatten(solveadj.adj_rooms), ratio="0.45", subdivide=Toggle(False))  # -> report, hb_objs; plug-in component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
aperturesbyratio_3 = HBAperturesByRatio(hb_objs=flatten(solveadj_2.adj_rooms), ratio="0.45", subdivide=Toggle(False))  # -> report, hb_objs; plug-in component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
model_4 = HBModel(rooms=flatten(aperturesbyratio_2.hb_objs))  # -> report, model; plug-in component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

path = FilePath("/Users/em/Dropbox/bldgtyp-00/00_PH_Tools/honeybee_ph/tests/_source_hbjson/")
data = Data(path)
data_2 = Data(Toggle(False))
data_3 = Data("2")

data_4 = Data(data)
data_5 = Data(data_2)
data_6 = Data(data)
data_7 = Data(data)
data_8 = Data(data_3)
data_9 = Data(data_3)
data_10 = Data(data_2)
data_11 = Data(data_3)
data_12 = Data(data_2)
data_13 = Data(data)
data_14 = Data(data_3)
data_15 = Data(data_2)
ph_bldg_segment = HBPHBldgSegment(hb_rooms=simplify(flatten(aperturesbyratio_3.hb_objs)))  # -> out, hb_rooms; inputs num_floor_levels: Int32, num_dwelling_units: Int32, source_energy_factors: list, co2e_factors: list, hb_rooms: list
#   port segment_name: (str) The name to give the new Honeybee Room.
#   port hb_rooms: (list) The Honeybee Rooms that you would like to join into a new single Room.
# ---------- ph_bldg_segment: Python ----------
#
# Honeybee-PH: A Plugin for adding Passive-House data to LadybugTools Honeybee-Energy Models
# 
# This component is part of the PH-Tools toolkit <https://github.com/PH-Tools>.
# 
# Copyright (c) 2022, PH-Tools and bldgtyp, llc <phtools@bldgtyp.com> 
# Honeybee-PH is free software; you can redistribute it and/or modify 
# it under the terms of the GNU General Public License as published 
# by the Free Software Foundation; either version 3 of the License, 
# or (at your option) any later version. 
# 
# Honeybee-PH is distributed in the hope that it will be useful,
# but WITHOUT ANY WARRANTY; without even the implied warranty of 
# MERCHANTABILITY or FITNESS FOR A PARTICULAR PURPOSE. See the 
# GNU General Public License for more details.
# 
# For a copy of the GNU General Public License
# see <https://github.com/PH-Tools/honeybee_ph/blob/main/LICENSE>.
# 
# @license GPL-3.0+ <http://spdx.org/licenses/GPL-3.0+>
#
"""
Use this component to add one or more honeybee-Rooms to a PH-Building-Segment. This 
'building-segment' could be a single floor, a 'wing' or an entire building and will 
map to a single 'Case' in WUFI or a single PHPP file.
-
Since Passive House models only allow for a single thermal zone, any honeybee-rooms 
that are part of the building-segment will be merged / joined when exported to 
WUFI-Passive or PHPP. When merged, only the exterior surfaces will be retained, and 
any faces with a 'Surface' boundary condition well be removed from the Passive House 
model. Only Honeybee Faces with boundary conditions of "Outdoors", "Ground" and 
"Adiabatic" will be included in the new Honeybee Room. 
-
Use this before passing the honeybee-rooms on to the 'HB Model' component.
-
EM April 8, 2022
    Args:
        segment_name_: Name for the building-segment
        
        occupancy_type_: Input either -
            "1-Residential" (default)
            "2-Non-residential"
        
        usage_type_: Input either -
            "1-Residential" (default)
            "4-Office/Administrative building"
            "5-School"
            "6-Other"
            "7-Undefined/unfinished"
        
        num_floor_levels_: (int) Total number of floor levels for the group of 
            Honeybee rooms input. Default=1
        
        num_dwelling_units_: (int) Total number of 'units' for the group of Honeybee rooms
            input For residential, this is the total number of dwelling units
            in the group of HB-Room. For non-residential, leave this set to "1".
        
        climate_: Optional Passive House monthly climate data.
        
        source_energy_factors_: (Optional) A list of source energy (site->source) energy 
            factors to use for assessing overall source (primary) energy usage. By default, 
            this component will use the standard Phius 2021 source energy factors which can be 
            found at https://www.phius.org/PHIUS+2021/Phius%20Core_Phius%20Zero_Final%20Modeling%20Protocol%20v1.1.pdf
            -
            Use the "Create Conversion Factor" component to define custom factors if you would 
            like to use your own. Be sure to define all of the fuel-factors required by Phius / WUFI.

        co2e_factors_: (Optional) A list of CO2e (site->CO2e) conversion 
            factors to use for assessing overall GHG emissions. By default, 
            this component will use the standard Phius 2021 CO2e factors which can be 
            found at https://www.phius.org/PHIUS+2021/Phius%20Core_Phius%20Zero_Final%20Modeling%20Protocol%20v1.1.pdf
            -
            Use the "Create Conversion Factor" component to define custom factors if you would 
            like to use your own. Be sure to define all of the fuel-factors required by Phius / WUFI.
        
        phius_certification_: Optional Phius certification thresholds.
        
        winter_set_temp_: default = 20C [68F]
        
        summer_set_temp_: default = 25C [77F]
    
    Returns:
        hb_rooms_: The honeyee-Rooms with building-segment information added.
"""

from honeybee.typing import clean_and_id_string

import honeybee_ph.phius
import honeybee_ph.bldg_segment
import honeybee_ph.location
from honeybee_ph_standards.sourcefactors import factors, phius_CO2_factors, phius_source_energy_factors
import honeybee_ph_utils.preview

# --- 
import honeybee_ph_rhino._component_info_
reload(honeybee_ph_rhino._component_info_)
ghenv.Component.Name = "HBPH - Bldg Segment"
DEV = True
honeybee_ph_rhino._component_info_.set_component_params(ghenv, dev='APR_08_2022')
if DEV:
    reload(honeybee_ph.phius)
    # reload(honeybee_ph.bldg_segment) # Breaks everyting.... sigh: Python 2
    reload(honeybee_ph.location)
    reload(honeybee_ph_utils.preview)
    reload(factors)
    reload(phius_CO2_factors)
    reload(phius_source_energy_factors)


def get_new_room_name(_br_count):
    # type: (int) -> str
    try:
        display_name = clean_and_id_string(_segment_name_.Branch(_br_count)[0])
    except:
        try:
            display_name = clean_and_id_string(_segment_name_.Branch(0)[0])
        except ValueError:
            display_name = 'Segment'
    
    return  clean_and_id_string(display_name)

# -- Sort our the new BldgSegment data
segment = honeybee_ph.bldg_segment.BldgSegment()
segment.name = _segment_name_ or 'Unnamed_Bldg_Segment'
segment.occupancy_type.value = occupancy_type_ or 1 #Residential
segment.usage_type.value = usage_type_ or 1
segment.num_floor_levels = num_floor_levels_ or 1
segment.num_dwelling_units = num_dwelling_units_ or 1
segment.climate = climate_ or honeybee_ph.location.Climate()
segment.ph_certification = phius_certification_ or honeybee_ph.phius.PhiusCertification()


# -- CO2 and Source Energy Factors
ALLOWED_FUELS = list(set(
    list(phius_source_energy_factors.factors_2021.keys()) +
    list(phius_CO2_factors.factors_2021.keys())
))

src_factors = source_energy_factors_ or factors.build_factors_from_library(
                                phius_source_energy_factors.factors_2021)
co2_factors = co2e_factors_ or factors.build_factors_from_library(
                                phius_CO2_factors.factors_2021)

segment.source_energy_factors = factors.FactorCollection('Source_Energy', src_factors)
segment.co2e_factors = factors.FactorCollection('CO2', co2_factors)
segment.source_energy_factors.validate_fuel_types(ALLOWED_FUELS)
segment.co2e_factors.validate_fuel_types(ALLOWED_FUELS)

# -- Preview
honeybee_ph_utils.preview.object_preview(segment)

# -- Apply the segment to the rooms
hb_rooms_ = []
for i, hb_room in enumerate(_hb_rooms):
    new_room = hb_room.duplicate()
    new_room.properties.ph.ph_bldg_segment = segment
    hb_rooms_.append(new_room)
# ---------- end ph_bldg_segment ----------
dumpobjects = HBDumpObjects(hb_objs=flatten(model_2.model), name="Default_Room_Single_Zone_wih_Apertures", folder=data_4, indent=data_8, dump=data_5)  # -> report, hb_file; plug-in component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
dumpobjects_2 = HBDumpObjects(hb_objs=flatten(model.model), name="Default_Model_Single_Zone", folder=data_6, indent=data_9, dump=data_10)  # -> report, hb_file; plug-in component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
dumpobjects_3 = HBDumpObjects(hb_objs=flatten(roomsolid_3.rooms), name="Default_Room_Single_Zone", folder=data_7, indent=data_11, dump=data_12)  # -> report, hb_file; plug-in component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
dumpobjects_4 = HBDumpObjects(hb_objs=flatten(model_3.model), name="Default_Room_Single_Zone_wih_Shades", folder=data_13, indent=data_14, dump=data_15)  # -> report, hb_file; plug-in component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
data_16 = Data(data)
data_17 = Data(data_2)
data_18 = Data(data_3)
dumpobjects_5 = HBDumpObjects(
    hb_objs=flatten(model_4.model),
    name="Default_Room_Multiple_Zones_wih_Apertures",
    folder=data_16,
    indent=data_18,
    dump=data_17)  # -> report, hb_file; plug-in component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
model_5 = HBModel(rooms=flatten(ph_bldg_segment.hb_rooms))  # -> report, model; plug-in component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
data_19 = Data(data)
data_20 = Data(data_3)
data_21 = Data(data_2)
panel = Panel("Default_Room_Multiple_Zones_wih_Apertures_Single_BldgSegment")
dumpobjects_6 = HBDumpObjects(hb_objs=flatten(model_5.model), name=panel, folder=data_19, indent=data_20, dump=data_21)  # -> report, hb_file; plug-in component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
